# Grasshopper definition PterodactylTests.gh (Grasshopper 1.0.7)
# plug-ins: Brontosaurus, Pterodactyl

calendar = Calendar()
# Format
# Parts
# Report
# Tools
# Basic Graphs
# Advanced Graph
panel = Panel("Test")
strong = Strong(Text="Test")
emphasis = Emphasis(Text=panel)
strike = Strike(Text="Test")
underline = Underline(Text="Test")
txt = Text("**Test**")
txt_2 = Text("*Test*")
txt_3 = Text("~~Test~~")
# File path to directory with test files
panel_2 = Panel("C:\Users\pc\RiderProjects\Pterodactyl\TestsInsideGrasshopper\")
txt_4 = Text("<u>Test</u>")
panel_3 = Panel(txt)
panel_4 = Panel(txt_2)
panel_5 = Panel(txt_3)
assert = Assert(TestNames="Strong", Expected=txt, Actual=strong)  # -> Result, FailedInfo
# Format
assert_2 = Assert(TestNames="Emphasis", Expected=txt_2, Actual=emphasis)  # -> Result, FailedInfo
assert_3 = Assert(TestNames="Strike", Expected=txt_3, Actual=strike)  # -> Result, FailedInfo
panel_6 = Panel(txt_4)
assert_4 = Assert(TestNames="Underline", Expected=txt_4, Actual=underline)  # -> Result, FailedInfo
entwine = Entwine(Branch00=assert_2.Result, Branch01=assert_3.Result, Branch02=assert.Result, Branch03=assert_4.Result, FlattenInputs=True)  # -> flatten(Result)
path = FilePath(panel_2)
concat = Concatenate(FragmentA=path, FragmentB="logo pterodactyl 100x100px.png")
concat_2 = Concatenate(FragmentA=path, FragmentB="Viewport.png")
panel_7 = Panel("""Content
Of
First
Heading""")
panel_8 = Panel("""Content
Of
Second
Heading""")
panel_9 = Panel("""Third
Heading
Content
!""")
panel_10 = Panel("""First item
Second item""")
panel_11 = Panel("""First task
Second task""")
panel_12 = Panel("""First item
Second item""")
panel_13 = Panel("""False
True""")
path_2 = FilePath(concat)
series = Series(Start=1, Step=1, Count=6)
panel_14 = Panel("""x
y""")
panel_15 = Panel("""45
30""")
panel_16 = Panel("""Heading 1
Heading 2
Heading 3""")
path_3 = FilePath(concat_2)
horizontal_line = HorizontalLine()
heading = Heading(Text="Test", Level=series)
entwine_2 = Entwine(Branch00=panel_7, Branch01=panel_8, Branch02=panel_9, FlattenInputs=True)
quote = Quote(Text="Test")
page_break = PageBreak()
unordered_list = UnorderedList(Items=panel_12)
ordered_list = OrderedList(Items=panel_10)
task_list = TaskList(Tasks=panel_11, Done=panel_13)
viewport = Viewport(
    Title="My viewport",
    ViewportName="Top",
    Path=path_3,
    DrawAxes=Toggle(True),
    DrawGrid=Toggle(True),
    DrawGridAxes=Toggle(True),
    TransparentBackground=Toggle(False))
image = Image(Title="Picture title", Path=path_2)
txt_5 = Text("------")
code_block = CodeBlock(ProgrammingLanguage="Python", Code="print(\"Hello world\")")
txt_6 = Text(["# Test", "## Test", "### Test", "#### Test", "##### Test", "###### Test"])
txt_7 = Text("[Test](www.google.com)")
txt_8 = Text("> Test")
txt_9 = Text("<div style=\"page-break-after: always;\"></div>")
panel_17 = Panel("""0
1
2""")
dynamic_math_block = DynamicMathBlock(Text="sin(<x>) + cos(<y>) = ?", VariablesSymbols=panel_14, VariablesValues=panel_15)
txt_10 = Text(["| Heading 1 | Heading 2 | Heading 3 |", "| --------- | :-------: | --------: |", "| Content   | Content   | Third     |", "| Of        | Of        | Heading   |", "| First     | Second    | Content   |", "| Heading   | Heading   | !         |"])
math_block = MathBlock(Text="sin(x) + cos(y) = ?")
txt_11 = Text("""1. First item
2. Second item""")
txt_12 = Text("""- [ ] First task
- [x] Second task""")
txt_13 = Text("""- First item
- Second item""")
panel_18 = Panel(txt_5)
panel_19 = Panel(txt_7)
assert_5 = Assert(TestNames="Horizontal Line", Expected=txt_5, Actual=horizontal_line)  # -> Result, FailedInfo
hyperlink = Hyperlink(Text="Test", Link="www.google.com")
panel_20 = Panel(txt_6)
panel_21 = Panel(txt_9)
panel_22 = Panel(txt_8)
assert_6 = Assert(TestNames="Page Break", Expected=txt_9, Actual=page_break)  # -> Result, FailedInfo
assert_7 = Assert(TestNames="Quote", Expected=txt_8, Actual=quote)  # -> Result, FailedInfo
table = Table(TableHeadings=panel_16, Alignment=panel_17, DataTree=entwine_2)
txt_14 = Text("""$$
sin(45) + cos(30) = ?
$$""")
# Parts
assert_list = AssertList(TestName="Heading", ExpectedList=txt_6, ActualList=heading)  # -> Result, FailedInfo
txt_15 = Text("""$$
sin(x) + cos(y) = ?
$$""")
panel_23 = Panel(txt_11)
panel_24 = Panel(txt_12)
panel_25 = Panel(txt_13)
txt_16 = Text("""```Python
print("Hello world")
```""")
panel_26 = Panel(txt_10)
txt_17 = Text("![Picture title](C:\Users\pc\RiderProjects\Pterodactyl\TestsInsideGrasshopper\logo pterodactyl 100x100px.png)")
assert_list_2 = AssertList(TestName="Ordered list", ExpectedList=txt_11, ActualList=ordered_list)  # -> Result, FailedInfo
assert_list_3 = AssertList(TestName="Unordered list", ExpectedList=txt_13, ActualList=unordered_list)  # -> Result, FailedInfo
txt_18 = Text("![My viewport](C:\Users\pc\RiderProjects\Pterodactyl\TestsInsideGrasshopper\Viewport.png)")
assert_list_4 = AssertList(TestName="Task list", ExpectedList=txt_12, ActualList=task_list)  # -> Result, FailedInfo
panel_27 = Panel(txt_14)
assert_8 = Assert(TestNames="Math Block", Expected=txt_15, Actual=math_block)  # -> Result, FailedInfo
panel_28 = Panel(txt_15)
panel_29 = Panel(txt_16)
assert_9 = Assert(TestNames="Image", Expected=txt_17, Actual=image)  # -> Result, FailedInfo
panel_30 = Panel(txt_17)
panel_31 = Panel(txt_18)
assert_10 = Assert(TestNames="Hyperlink", Expected=txt_7, Actual=hyperlink)  # -> Result, FailedInfo
assert_list_5 = AssertList(TestName="Code block", ExpectedList=txt_16, ActualList=code_block)  # -> Result, FailedInfo
assert_list_6 = AssertList(TestName="Dynamic Math Block", ExpectedList=txt_14, ActualList=dynamic_math_block)  # -> Result, FailedInfo
assert_11 = Assert(TestNames="Viewport", Expected=txt_18, Actual=viewport)  # -> Result, FailedInfo
assert_list_7 = AssertList(TestName="Table", ExpectedList=txt_10, ActualList=table)  # -> Result, FailedInfo
entwine_3 = Entwine(Branch00=assert_list_2.Result, Branch01=assert_list_4.Result, Branch02=assert_list_3.Result, FlattenInputs=True)  # -> flatten(Result)
entwine_4 = Entwine(
    Branch00=assert_list.Result,
    Branch01=assert_5.Result,
    Branch02=assert_10.Result,
    Branch03=assert_6.Result,
    Branch04=assert_7.Result,
    Branch05=assert_list_7.Result,
    FlattenInputs=True)  # -> flatten(Result)
entwine_5 = Entwine(Branch00=assert_list_5.Result, Branch01=assert_list_6.Result, Branch02=assert_8.Result, FlattenInputs=True)  # -> flatten(Result)
entwine_6 = Entwine(Branch00=assert_9.Result, Branch01=assert_11.Result, FlattenInputs=True)  # -> flatten(Result)
emphasis_2 = Emphasis(Text="Test")
strike_2 = Strike(Text="Test")
panel_32 = Panel("Emphasis")
panel_33 = Panel("Strike")
# Report
create_report = CreateReport(ReportParts=[emphasis_2, strike_2], Title="Report", TableOfContents=Toggle(True), AutoSpacing=False)
concat_3 = Concatenate(FragmentA=path, FragmentB="ReportExample.md")
panel_34 = Panel(create_report)
path_4 = FilePath(concat_3)
txt_19 = Text("""# Report
[TOC]
*Test*
~~Test~~""")
save_report = SaveReport(Report=create_report, Path=path_4)
assert_12 = Assert(TestNames="Create Report", Expected=txt_19, Actual=create_report)  # -> Result, FailedInfo
panel_35 = Panel(txt_19)
entwine_7 = Entwine(Branch00=assert_12.Result, FlattenInputs=True)  # -> flatten(Result)
flowchart_start_node = FlowchartStartNode(Text="First", Shape=0)
panel_36 = Panel("""Category 1
Category 2
Category 3""")
panel_37 = Panel("""0.23
0.66
1.45""")
flowchart_link = FlowchartLink(Type="2", Node=flowchart_start_node, Text="Sample text")
flowchart_start_node_2 = FlowchartStartNode(Text="First Node", Shape=0)
flowchart_start_node_3 = FlowchartStartNode(Text="First Node", Shape=0)
flowchart_start_node_4 = FlowchartStartNode(Text="First", Shape=Slider(3, range=0..10))
flowchart_start_node_5 = FlowchartStartNode(Text="First", Shape=0)
flowchart_link_2 = FlowchartLink(Type="1", Node=flowchart_start_node_3, Text="My Link")
pie_chart = PieChart(Title="Title of chart", Categories=panel_36, Values=panel_37)
txt_20 = Text("""```mermaid
pie title Title of chart
    "Category 1" : 0.23
    "Category 2" : 0.66
    "Category 3" : 1.45
```""")
flowchart_node = FlowchartNode(Text="Second", NodeLink=flowchart_start_node, Shape=0)
flowchart_node_2 = FlowchartNode(Text="Third", NodeLink=flowchart_start_node, Shape=0)
flowchart_node_3 = FlowchartNode(Text="Fourth", NodeLink=flowchart_start_node, Shape=0)
flowchart_node_4 = FlowchartNode(Text="Sixth", NodeLink=flowchart_link, Shape="8")
flowchart_node_5 = FlowchartNode(Text="Second Node", NodeLink=flowchart_start_node_2, Shape=0)
flowchart_node_6 = FlowchartNode(Text="Second Node", NodeLink=flowchart_link_2, Shape=0)
flowchart_node_7 = FlowchartNode(Text="Second", NodeLink=flowchart_start_node_4, Shape=Slider(5, range=0..10))
flowchart_node_8 = FlowchartNode(Text="First", NodeLink=flowchart_start_node_5, Shape=0)
# Tools
panel_38 = Panel("Pie Chart")
panel_39 = Panel(txt_20)
assert_13 = Assert(TestNames=panel_38, Expected=txt_20, Actual=pie_chart)  # -> Result, FailedInfo
flowchart = Flowchart(Direction=Toggle(True), LastNodes=flowchart_node_5)
flowchart_2 = Flowchart(Direction=Toggle(True), LastNodes=flowchart_node_6)
flowchart_3 = Flowchart(Direction=Toggle(True), LastNodes=flowchart_node_7)
flowchart_4 = Flowchart(Direction=Toggle(True), LastNodes=flowchart_node_8)
flowchart_node_9 = FlowchartNode(Text="Fifth", NodeLink=[flowchart_node, flowchart_node_2, flowchart_node_3], Shape=0)
txt_21 = Text("""```mermaid
graph LR
First_Node --> Second_Node
```""")
txt_22 = Text("""```mermaid
graph LR
First_Node -- My Link --- Second_Node
```""")
txt_23 = Text("""```mermaid
graph LR
First[[First]] --> Second((Second))
```""")
txt_24 = Text("""```mermaid
graph LR
First --> First
```""")
panel_40 = Panel(txt_22)
panel_41 = Panel(txt_21)
panel_42 = Panel(txt_23)
panel_43 = Panel(txt_24)
assert_14 = Assert(TestNames="Simple flowchart", Expected=txt_21, Actual=flowchart)  # -> Result, FailedInfo
assert_15 = Assert(TestNames="Simple flowchart with link", Expected=txt_22, Actual=flowchart_2)  # -> Result, FailedInfo
assert_16 = Assert(TestNames="Different shapes", Expected=txt_23, Actual=flowchart_3)  # -> Result, FailedInfo
assert_17 = Assert(TestNames="Self pointing node", Expected=txt_24, Actual=flowchart_4)  # -> Result, FailedInfo
flowchart_5 = Flowchart(Direction=Toggle(True), LastNodes=[flowchart_node_9, flowchart_node_4])
txt_25 = Text("""```mermaid
graph LR
First --> Second
Second --> Fifth
First --> Third
Third --> Fifth
First --> Fourth
Fourth --> Fifth
First -. Sample text .-> Sixth{Sixth}
```""")
panel_44 = Panel(txt_25)
assert_18 = Assert(TestNames="Complex flowchart", Expected=txt_25, Actual=flowchart_5)  # -> Result, FailedInfo
entwine_8 = Entwine(
    Branch00=assert_13.Result,
    Branch01=assert_14.Result,
    Branch02=assert_15.Result,
    Branch03=assert_16.Result,
    Branch04=assert_17.Result,
    Branch05=assert_18.Result,
    FlattenInputs=True)  # -> flatten(Result)
concat_4 = Concatenate(FragmentA=path, FragmentB="LineGraph.png")
concat_5 = Concatenate(FragmentA=path, FragmentB="PieChart.png")
concat_6 = Concatenate(FragmentA=path, FragmentB="BarChart.png")
concat_7 = Concatenate(FragmentA=path, FragmentB="ColumnChart.png")
concat_8 = Concatenate(FragmentA=path, FragmentB="PointGraph.png")
path_5 = FilePath(concat_4)
path_6 = FilePath(concat_5)
path_7 = FilePath(concat_6)
path_8 = FilePath(concat_7)
path_9 = FilePath(concat_8)
bar_chart = BarChart(
    ShowGraph=False,
    Title="Wingspan comparison (size matters)",
    Values=[0.68, 0.81, 1, 1.2, 1.6, 6],
    BarNames=["Pigeon", "Duck", "Crow", "Owl", "Peacock", "Pterodactyl"],
    TextFormat="{0:0.00[m]}",
    Colors=[RGB(255, 110, 110), RGB(7, 173, 148), RGB(153, 255, 0), RGB(255, 119, 0), RGB(168, 45, 160), RGB(115, 115, 115)],
    Path=path_7)
column_chart = ColumnChart(
    ShowGraph=False,
    Title="Wingspan comparison (size matters)",
    Values=[0.68, 0.81, 1, 1.2, 1.6, 6],
    ColumnNames=["Pigeon", "Duck", "Crow", "Owl", "Peacock", "Pterodactyl"],
    TextFormat="{0:0.00[m]}",
    Colors=[RGB(255, 110, 110), RGB(7, 173, 148), RGB(153, 255, 0), RGB(255, 119, 0), RGB(168, 45, 160), RGB(115, 115, 115)],
    Path=path_8)
pie_chart_2 = PieChart(
    ShowGraph=False,
    Title="Reaction to Pterodactyl plugin",
    Values=[54, 34, 1],
    SlicesNames=["Happy", "Excited", "Holy cow"],
    Colors=[RGB(255, 119, 0), RGB(168, 45, 160), RGB(115, 115, 115)],
    Path=path_6)
point_graph = PointGraph(
    ShowGraph=False,
    Title="Awesomeness of Pterodactyl plugin",
    XValues=[0, 0.5, 1, 1.5, 2, 2.5, 3, 3.5, 4, 4.5],
    YValues=[1, 1.414214, 2, 2.828427, 4, 5.656854, 8, 11.313708, 16, 22.627417],
    XName="Time",
    YName="Awesomeness",
    Color=RGB(0, 0, 0),
    Path=path_9)
line_graph = LineGraph(
    ShowGraph=False,
    Title="Awesomeness of Pterodactyl plugin",
    XValues=[0, 0.5, 1, 1.5, 2, 2.5, 3, 3.5, 4, 4.5],
    YValues=[1, 1.414214, 2, 2.828427, 4, 5.656854, 8, 11.313708, 16, 22.627417],
    XName="Time",
    YName="Awesomeness",
    Color=RGB(0, 0, 0),
    Path=path_5)
txt_26 = Text("![Wingspan comparison (size matters)](C:\Users\pc\RiderProjects\Pterodactyl\TestsInsideGrasshopper\BarChart.png)")
txt_27 = Text("![Wingspan comparison (size matters)](C:\Users\pc\RiderProjects\Pterodactyl\TestsInsideGrasshopper\ColumnChart.png)")
# Basic Graphs
panel_45 = Panel("Bar Chart")
txt_28 = Text("![Awesomeness of Pterodactyl plugin](C:\Users\pc\RiderProjects\Pterodactyl\TestsInsideGrasshopper\LineGraph.png)")
txt_29 = Text("![Awesomeness of Pterodactyl plugin](C:\Users\pc\RiderProjects\Pterodactyl\TestsInsideGrasshopper\PointGraph.png)")
txt_30 = Text("![Reaction to Pterodactyl plugin](C:\Users\pc\RiderProjects\Pterodactyl\TestsInsideGrasshopper\PieChart.png)")
panel_46 = Panel(txt_26)
panel_47 = Panel(txt_27)
assert_19 = Assert(TestNames=panel_45, Expected=txt_26, Actual=bar_chart)  # -> Result, FailedInfo
assert_20 = Assert(TestNames="Column Chart", Expected=txt_27, Actual=column_chart)  # -> Result, FailedInfo
assert_21 = Assert(TestNames="Line Graph", Expected=txt_28, Actual=line_graph)  # -> Result, FailedInfo
panel_48 = Panel(txt_28)
assert_22 = Assert(TestNames="Point Graph", Expected=txt_29, Actual=point_graph)  # -> Result, FailedInfo
panel_49 = Panel(txt_29)
assert_23 = Assert(TestNames="Pie Chart", Expected=txt_30, Actual=pie_chart_2)  # -> Result, FailedInfo
panel_50 = Panel(txt_30)
entwine_9 = Entwine(
    Branch00=assert_19.Result,
    Branch01=assert_20.Result,
    Branch02=assert_21.Result,
    Branch03=assert_23.Result,
    Branch04=assert_22.Result,
    FlattenInputs=True)  # -> flatten(Result)
series_2 = Series(Start=Slider(0, range=0..100), Step=Slider(0.1, range=0..0.1), Count=Slider(50, range=0..100))
ln = NaturalLogarithm(Value=series_2)
log = Logarithm(Value=series_2)
line_data = LineData(Color=ColourSwatch(SwatchColor=RGB(11, 184, 149)), Interpolation=0, LineStyle=0, LineWeight=2)
point_data = PointData(Color=ColourSwatch(SwatchColor=RGB(255, 0, 234)), Marker=1, Size=4.5)
# Advanced Graph
entwine_10 = Entwine(Branch00=series_2, Branch01=series_2, FlattenInputs=True)
entwine_11 = Entwine(Branch00=ln, Branch01=log, FlattenInputs=True)
panel_51 = Panel("""LN
LOG""")
graph_axis = GraphAxis(XAxisName="My X Axis", YAxisName="My Y Axis", CAxisName="Color range", AxisPadding=0.01, TextSize=12)
graph_data = GraphData(XValues=entwine_10, YValues=entwine_11, ValuesNames=panel_51, DataType=[line_data, point_data])
graph_sizes = GraphSizes(Width="1000", Height="400")
graph_legend = GraphLegend(Title="Legend", Position="11", Placement=0, Orientation=1, TextSize=12)
graph_settings = GraphSettings(
    Title="My title",
    GraphSizes=graph_sizes,
    Color=ColourSwatch(SwatchColor=RGB(196, 196, 196)),
    GraphAxis=graph_axis,
    GraphPadding=8,
    TitleSize=18)
graph_elements = GraphElements(GraphData=graph_data, GraphLegend=graph_legend)
concat_9 = Concatenate(FragmentA=path, FragmentB="AdvancedChart.png")
path_10 = FilePath(concat_9)
graph = Graph(ShowGraph=False, GraphElements=graph_elements, GraphSettings=graph_settings, Path=path_10)
txt_31 = Text("![My title](C:\Users\pc\RiderProjects\Pterodactyl\TestsInsideGrasshopper\AdvancedChart.png)")
assert_24 = Assert(TestNames="Advanced Chart", Expected=txt_31, Actual=graph)  # -> Result, FailedInfo
panel_52 = Panel(txt_31)
entwine_12 = Entwine(Branch00=assert_24.Result, FlattenInputs=True)  # -> flatten(Result)
total = Total(Results=[entwine, entwine_4, entwine_3, entwine_5, entwine_6, entwine_7, entwine_8, entwine_9, entwine_12])  # -> TotalResult, ReportPart
panel_53 = Panel(total.TotalResult)
